# Grasshopper definition inputDescription.gh (Grasshopper 0.9.76)
# plug-ins: Python Interpreter

python = PythonScript()  # -> out, a
# ---------- python: Python ----------
"""
This is a very special component!

    Args:
        x: First input.
    Returns:
        a: The only output.
"""

ghenv.Component.Params.Input[1].Description = "Second input."
# ---------- end python ----------
