# Grasshopper definition panelmappings.gh (Grasshopper 1.0.4)

c_script = CSharpScript()  # -> out, A
# ---------- c_script: C# ----------
    A = Grasshopper.Kernel.Special.GH_Panel.GetMappingList();
# ---------- end c_script ----------
panel = Panel(c_script.A)
panel_2 = Panel("3{dot}10{^-3} {times} 2{dot}10{^+7} = 6{dot}10{^+4}")
panel_3 = Panel("N{_n-1} + N{_n+2}")
panel_4 = Panel("Copyright {copyright} 2016")
panel_5 = Panel("1.00{dollar} {right} 0.89{euro}")
panel_6 = Panel("I'm {---}really{---} impressed by this.")
